# Grasshopper definition grasshopper.gh (Grasshopper 1.0.7)

path = FilePath("C:\Users\Nagy\Documents\GitHub\grasshopper-python\python.py")
python = GhPythonScript(input=Slider(5, range=0..10), script_path=path)  # -> out, output
# ---------- python: Python ----------
import cPickle as pickle
import os
import subprocess

def quote(s):
    if s is None:
        return 'None'
    return '\"' + s + '\"'


### GET LOCAL PATH
file_path = ghenv.Component.OnPingDocument().FilePath.split("\\")


### GET PATHS TO SCRIPT AND DATA FILE
#script_path = "\\".join(file_path[:-1] + ["python.py"])
temp_path = "\\".join(file_path[:-1] + ["_temp"])

if not os.path.exists(temp_path):
    os.mkdir(temp_path)

data_path = temp_path + "\\script_inputs.d"


### CONFIGURE PYTHON COMMAND
cmds = []
cmds.append( "C:" )
cmds.append( "cd {}".format(quote("\\".join(file_path[:-1]))) )
cmds.append( "install.bat" )
cmds.append( "python {} {}".format(quote(script_path), quote(data_path)) )

print cmds


### DUMP DATA TO LOCAL FILE
with open(data_path, "wb") as f:
    pickle.dump(input, f)


### RUN PYTHON SCRIPT IN EXTERNAL CMD PROMPT
try:
    output = subprocess.check_output("&&".join(cmds), stderr=subprocess.STDOUT, shell=True)
except subprocess.CalledProcessError as exc:
    print 'error: code={}, out="{}"'.format(exc.returncode, exc.output, )
print output

output_path = output.split('\n')[-2]
output_path = ('\\\\').join(output_path.strip().split('\\'))
print output_path

with open(output_path, 'rb') as f:
    data_in = pickle.load(f)
print data_in

output = data_in
# ---------- end python ----------
panel = Panel(python.output)
